vi "802.11 Host.gvi"   [LabVIEW Communications System Design Suite 2.0.1]
# Open UDP socket used to receive UDP packets forwarded to the target TX. This node creates a packet of pseudorandom numbers in PN mode.
# Refer also to Data source in 802.11802.11 v2.0802.11 v2.0802.11 Host.gvi.
panel controls:
  "Trigger TX": bool
  "Clear events": bool
  "Operation Mode": T2 = "RF Loopback"
  "Primary Subband": UFXP(2.0) = 1
  "Transmit IP Address": string = "127.0.0.1"
  "Transmit Port": u16 = 12346
  "Tab": i32
  "Power Level [dBm]": f64
  "TX Frequency [Hz]": f64 = 2437000000
  "Destination MAC Address": u8[6] = [71, 111, 75, 117, 109, 98]
  "Device MAC Address": u8[6] = [71, 111, 75, 117, 109, 97]
  "TX Port (USRP only)": enum{"TX1/RF 0", "TX1/RF 1"} = "TX1/RF 0"
  "RX Port (USRP only)": T3 = "RX2/RF 1"
  "AGC": bool = TRUE
  "Manual RX gain [dB]": f64 = 37.5
  "PN Data Packet Size": i32 = 1024
  "Subcarrier Format": i32 = "20 MHz (IEEE 802.11 a)"(0)
  "Stop": bool
  "RIO Device": string = "RIO0"
  "Station": bool
  "reset TX staistics": bool
  "reset RX staistics": bool
  "PN Packets per Second": u32 = 1000
  "Transmit ACK": bool = TRUE
  "Backoff": u16 = 4
  "All": bool
  "None": bool
  "Events to Track": T5
  "CCA Energy Detection Threshold [dBm]": FXP(10.3) = -72
  "MCS": UFXP(4.0) = 4
  "session": "802.11 Host Session.gtype"
  "Data Source Option": i32 = 1
  "Data Sink Options": i32
  "Data Source": enum{"UDP", "PN Data", "Manual"} = "PN Data"
  "Data Sink": enum{"Off", "UDP"} = "Off"
  "Reference Clock": string = "Internal"
  "USRP bandwidth": "USRP bandwidth.gtype" = "40 MHz"
  "Receive Port": u16[]
panel indicators:
  "Events": string
  "MAC TX Statistic": T1
  "Baseband Power": f64
  "Coerced LO frequency TX [Hz]": f64
  "Coerced LO frequency RX [Hz]": f64
  "Channel Estimation": cluster{"Element 1": i32[], "Element 2": f64[]}[]
  "TX Block Error Rate": f64
  "Coerced Power Level [dBm]": f64
  "RX Throughput": f64
  "Applied RX Gain [dB]": f64
  "RX Throughput [bits/s]": f64
  "Current TX Block Error Rate (BLER)": f64
  "RX Frequency [Hz]": f64
  "Overwritten by Device MAC Address": bool
  "Station Active": bool
  "Device Ready": bool
  "Baseband RX Power [dBFS]": f64
  "RX Constellation": c128[]
  "RX Power Spectrum": T4
  "TX Power Spectrum": T4
  "Data Transfer": bool
  "FIFO Full": bool
  "FIFO Full": bool
  "Data Transfer": bool
  "Compensated CFO [Hz]": f64
  "TX Data Dropped": bool
  "modulation and coding rate": string
  "MAC RX Statistic": T10
  "Target FIFO Overflow": bool
  "RF Input Power": f64[][]
types:
  T1 = cluster{"TX after SIFS Requests Detected": u32, "TX after SIFS Requests Completed": u32, "TX after Backoff Requests Detected": u32, "TX after Backoff Requests Completed": u32}
  T2 = enum{"Baseband Loopback", "RF Loopback", "RF Multi Station"}
  T3 = enum{"RX1/RF 0", "RX2/RF 0", "RX1/RF 1", "RX2/RF 1"}
  T4 = cluster{"f0": f64, "df": f64, "magnitude": f64[]}
  T5 = cluster{"PhyTxStart": bool, "PhyTxEnd": bool, "PhyRxStart": bool, "PhyRxEnd": bool, "MacChannelState": bool, "MacTxStatus": bool, "PhyCcaTiming": bool, "PhyCcaTiming_2": bool, "PhyCcaTiming_3": bool}
  T6 = cluster{"Timestamp": u32, "Transferred Bytes": u32}
  T7 = cluster{"fpga ref": any, "bus instance": u32, "instruction FIFO depth": u32, "executing on FPGA target": bool, "show error call chain": bool}
  T8 = cluster{"Actual Gain [dB]": f64, "Attenuation Table Index": i32}
  T9 = cluster{"Attenuation Table [dB]": f64[][], "Frequencies [Hz]": f64[], "IQ Imbalance Table": "niUsrpRio Config v1 Host.lvlib__IQ Imbalance.gtype"[], "Gain Table": T8[][]}
  "niInstr Register Bus v0 Host.lvlib__Register Bus Session.gtype" = Queue<"niInstr Register Bus v0 Host.lvlib__Session Data.gtype">
  "Semaphore RefNum.gtype" = i32
  "niUsrpRio Config v1 Host.lvlib__DB Queue Reference.gtype" = Queue<"niUsrpRio Config v1 Host.lvlib__Daughterboard Data.gtype">
  "niUsrpRio Config v1 Host.lvlib__niUsrpRio Session.gtype" = cluster{"FPGA Interface": any, "RIO Interface Number": u32, "Data Clock Rate": u32, "FPGA Data Clock Rate": u32, "Global Settings Register Bus": "niInstr Register Bus v0 Host.lvlib__Register Bus Session.gtype", "Radio 0 Settings Register Bus": "niInstr Register Bus v0 Host.lvlib__Register Bus Session.gtype", "Radio 1 Settings Register Bus": "niInstr Register Bus v0 Host.lvlib__Register Bus Session.gtype", "Radio Settings Bus Semaphore": "Semaphore RefNum.gtype", "DB Queues": "niUsrpRio Config v1 Host.lvlib__DB Queue Reference.gtype"[], "Characterization Data Valid?": bool, "EEPROM Header": "niUsrpRio Config v1 Host.lvlib__EEPROM Header.gtype", "Device Data Header": "niUsrpRio Config v1 Host.lvlib__EEPROM Device Data Header.gtype", "EEPROM Characterization Header": "niUsrpRio Config v1 Host.lvlib__EEPROM Characterization Header.gtype", "Characterization Data": "niUsrpRio Config v1 Host.lvlib__Characterization Data.gtype"[], "FPGA Current Version": u32, "FPGA Oldest Compatible Version": u32, "Fixed Logic Current Version": u32, "Fixed Logic Oldest Compatible Version": u32, "FPGA Radio Settings Bus Current Version": u32, "FPGA Radio Settings Bus Oldest Compatible Version": u32, "FPGA Board Config Current Version": u32, "FPGA Board Config Oldest Compatible Version": u32, "Daughterboard Clock Rate": u32}
  "802.11 Host Session.gtype" = cluster{"FPGA interface": "802.11 FGPA Reference.gtype", "send queue": Queue<u8[]>, "receive queue": Queue<u8[]>, "receive throughput queue": Queue<T6>, "UDP Receiver": UdpNetworkConnectionRefnum, "PN packet": u8[], "FlexRIO session": Queue<T7>, "FlexRIO TX Characterization Data": T9, "FlexRIO RX Characterization Data": T9, "USRP session": "niUsrpRio Config v1 Host.lvlib__niUsrpRio Session.gtype", "RF loop clock frequency": f64, "send queue_2": Queue<u8[]>, "send queue_3": Queue<u8[]>, "send queue_4": Queue<u8[]>, "send queue_5": Queue<u8[]>, "UDP Receiver_2": UdpNetworkConnectionRefnum, "UDP Receiver_3": UdpNetworkConnectionRefnum, "UDP Receiver_4": UdpNetworkConnectionRefnum, "UDP Receiver_5": UdpNetworkConnectionRefnum, "receive queue_2": Queue<u8[]>, "receive queue_3": Queue<u8[]>, "receive queue_4": Queue<u8[]>, "receive queue_5": Queue<u8[]>}
  T10 = cluster{"Packet Starts detected": u32, "Frames from PHY": u32, "Frames with FCS pass": u32, "ACKs Received": u32}
  "USRP bandwidth.gtype" = enum{"40 MHz", "120 MHz", "160 MHz"}
  T11 = cluster{"TX after SIFS requests detected": u32, "TX after SIFS requests completed": u32, "TX after backoff requests detected": u32, "TX after backoff requests completed": u32}
  T12 = cluster{"Frames detected": u32, "Subframes received": u32, "Valid subframes received": u32, "ACKs received": u32}
  T13 = cluster{"PhyTxStart": bool, "PhyTxEnd": bool, "PhyRxStart": bool, "PhyRxEnd": bool, "MacChannelState": bool, "MacTxStatus": bool, "PhyCcaTiming": bool, "PhyRxGainChange": bool, "PhyRxAGCStateChange": bool}
  T14 = cluster{"remove header": bool, "block unsupported frame types": bool, "block FCS errors": bool, "block address mismatch": bool, "block header recognize error": bool}
diagram:
  sequence {
    frame 0 {
      $Events <- EmptyString
      $"Device Ready" <- FALSE
      $"Station Active" <- FALSE
      $Station <- FALSE
      $"RX Constellation" <- c128[] []
      $"RX Power Spectrum" <- T4 {all zero or empty}
      $"TX Power Spectrum" <- T4 {all zero or empty}
      $"Channel Estimation" <- cluster{"Element 1": i32[], "Element 2": f64[]}[] []
      $"MAC TX Statistic" <- T11 {all zero or empty}
      $"MAC RX Statistic" <- T12 {all zero or empty}
      $"Current TX Block Error Rate (BLER)" <- 0
      $"RX Throughput [bits/s]" <- 0
      $"Compensated CFO [Hz]" <- 0
      for (N = 51) {
        $"RX Throughput" <- NaN
        $"TX Block Error Rate" <- NaN
        $"Baseband Power" <- NaN
      }
      Initialize Array(element=NaN, size=51, size=2) -> w1
      $"RF Input Power" <- w1
    }
  }
  call "Create Stop Notifier.gvi"(error in=no error) -> (error out=w2)
  call "802.11 Host Init.gvi"(device=$"RIO Device", error in=w2, reference clock=$"Reference Clock", USRP bandwidth=$"USRP bandwidth") -> (session out=w3, error out=w4)
  case (w4) {
    frame Error {
      w5 = w4
    }
    frame No Error {
      $"Device Ready" <- TRUE
      $session <- w3
      w5 = w4
    }
  }
  s1 = w5  # shift register
  while {
    # RX Reception
    call "802.11 Unbundle Session.gvi"(session=$session) -> (FPGA interface=w6, receive queue=w7, receive throughput queue=w8)
    call "802.11 Receive RX ICP.gvi"(FPGA interface=w6, error in=s1, receive queue=w7, receive throughput queue=w8, enqueue decoded data=$"Station Active") -> (error out=w9)
    call "Check Stop.gvi"(error in=w9) -> (error out=w10, stop=w11)
    Wait Until Next Multiple(multiple to wait=0)
    next s1 = w10
    stop if w11
  }
  call "Stop On Error.gvi"(error in=s1) -> (error out=w12)
  s2 = w5  # shift register
  s3 = string[] []  # shift register
  while {
    call "802.11 Unbundle Session.gvi"(session=$session) -> (FPGA interface=w13)
    call "802.11 Prepare Constellation.gvi"(FPGA interface=w13, error in=s2, maximal number of subcarriers=4800) -> (error out=w14, data field constellation=w15, update constellation=w16)
    # update plots and indicators (slow)
    Logical And($"Station Active", w16) -> w17
    case (w17) {
      frame False { }
      frame True {
        $"RX Constellation" <- w15
      }
    }
    call "802.11 Read Event FIFO.gvi"(FPGA interface=w13, error in=s2) -> (raw events=w18, error out=w19)
    call "802.11 Prepare RX Power Spectrum.gvi"(FPGA interface=w13, error in=s2) -> (error out=w20, RX power spectrum=w21, update power spectrum=w22)
    call "802.11 Prepare TX Power Spectrum.gvi"(FPGA interface=w13, error in=s2) -> (error out=w23, TX power spectrum=w24, update power spectrum=w25)
    call "802.11 Prepare Channel Estimation.gvi"(FPGA interface=w13, error in=s2, channel subband=$"Primary Subband", subcarrier format=$"Subcarrier Format") -> (error out=w26, channel estimation=w27, update power spectrum=w28)
    call "802.11 Read Target Registers.gvi"(FPGA interface=w13, error in=s2) -> (error out=w29, target FIFO overflow=w30, compensated CFO=w31, RF input power=w32, MAC RX statistics=w33, MAC TX statistics=w34, signal power at packet start=w35)
    Merge Errors(w14, w20, w23, w26, w29, w19) -> (error out=w36)
    call "Check Stop.gvi"(error in=w36) -> (error out=w37, stop=w38)
    Logical And($"Station Active", w22) -> w39
    case (w39) {
      frame False, Default { }
      frame True {
        $"RX Power Spectrum" <- w21
      }
    }
    Logical And($"Station Active", w25) -> w40
    case (w40) {
      frame False, Default { }
      frame True {
        $"TX Power Spectrum" <- w24
      }
    }
    Logical And($"Station Active", w28) -> w41
    case (w41) {
      frame False, Default { }
      frame True {
        $"Channel Estimation" <- w27
      }
    }
    $"Target FIFO Overflow" <- w30
    $"Compensated CFO [Hz]" <- w31
    $"RF Input Power" <- w32
    $"Baseband Power" <- w35
    $"MAC RX Statistic" <- w33
    $"MAC TX Statistic" <- w34
    call "802.11 Events to String.gvi"(event data=w18, events to track=$"Events to Track") -> (event strings=w42)
    for {
      w43 = each element of w42
      Match Pattern(regular expression="PhyRxStart.ind ", string=w43) -> (offset past match=w45)
      Is Not Equal(x=w45, y=-1) -> w46
      append w46 to w44
    }
    Or Array Elements(Boolean array=w44)
    w47 = -12  # CFX data type offset
    Add(w35, w47) -> w48
    $"Baseband RX Power [dBFS]" <- w48
    Build Array[ConcatenateInputs=True](s3, w42) -> w49
    Delete From Array(inArray=w49, length (1)=10000) -> (deleted=w50)
    Select(s=$"Clear events", t=string[] [], f=w50) -> w51
    Concatenate Strings(w50) -> w52
    $Events <- w52
    Select(s=$None, t=T13 {all zero or empty}, f=$"Events to Track") -> w53
    w54 = T13 {"PhyTxStart"=TRUE, "PhyTxEnd"=TRUE, "PhyRxStart"=TRUE, "PhyRxEnd"=TRUE, "MacChannelState"=TRUE, "MacTxStatus"=TRUE, "PhyCcaTiming"=TRUE, "PhyRxGainChange"=TRUE, "PhyRxAGCStateChange"=TRUE}
    Select(s=$All, t=w54, f=w53) -> w55
    $"Events to Track" <- w55
    Wait Until Next Multiple(multiple to wait=250)
    next s2 = w37
    next s3 = w51
    stop if w38
  }
  call "Stop On Error.gvi"(error in=s2) -> (error out=w56)
  s4 = w5  # shift register
  while {
    Feedback Node(input=$"Station Active") -> w57
    Is Not Equal(x=$"Station Active", y=w57) -> w58
    # update plots and indicators (fast)
    case ($"Station Active") {
      frame False, Default {
        w59 = s4
      }
      frame True {
        call "802.11 Unbundle Session.gvi"(session=$session) -> (FPGA interface=w60, receive throughput queue=w61)
        call "802.11 Prepare Throughput Measurements.gvi"(reset=w58, FPGA interface=w60, receive throughput queue=w61, error in=s4, timing granularity=100) -> (error out=w59, TX block error rate=w62, RX throughput=w63)
        $"Current TX Block Error Rate (BLER)" <- w62
        $"TX Block Error Rate" <- w62
        $"RX Throughput [bits/s]" <- w63
        Divide(x=w63, y=1000000) -> w64
        $"RX Throughput" <- w64
      }
    }
    call "Check Stop.gvi"(error in=w59) -> (error out=w65, stop=w66)
    Wait Until Next Multiple(multiple to wait=100)
    next s4 = w65
    stop if w66
  }
  call "Stop On Error.gvi"(error in=s4) -> (error out=w67)
  s5 = w5  # shift register
  while {
    # TX transmission
    call "802.11 Unbundle Session.gvi"(session=$session) -> (FPGA interface=w68, send queue=w69)
    w70 = $"Station Active"
    while {
      Dequeue Element(error in=s5, queue=w69, timeout in ms=0) -> (element=w71, error out=w72, timed out?=w73)
      Logical And(w70, not w73) -> w74
      case (w74) {
        frame False {
          w75 = w72
        }
        frame True {
          call "802.11 Subcarrier Format to Configuration.gvi"(MCS=$MCS, subcarrier format=$"Subcarrier Format", error in=w72) -> (error out=w76, format=w77, bandwidth=w78, valid configuration=w79)
          Is Not Equal(x=$"Operation Mode", y="RF Multi Station") -> w80
          Select(s=w80, t=$"Device MAC Address", f=$"Destination MAC Address") -> w81
          case (w79) {
            frame False, Default {
              w82 = FALSE
              w75 = w76
            }
            frame True {
              call "802.11 Send TX ICP.gvi"(FPGA interface=w68, MCS=$MCS, device MAC address=$"Device MAC Address", error in=w76, destination MAC address=w81, payload=w71, format=w77, bandwidth=w78) -> (dropped?=w82, error out=w75)
            }
          }
          $"TX Data Dropped" <- w82
          $"Overwritten by Device MAC Address" <- w80
        }
      }
      call "Check Stop.gvi"(error in=w75) -> (error out=w83, stop=w84)
      Logical Or(w84, w73) -> w85
      stop if w85
    }
    call "Check Stop.gvi"(error in=w83) -> (error out=w86, stop=w87)
    Wait Until Next Multiple(multiple to wait=0)
    next s5 = w86
    stop if w87
  }
  call "Stop On Error.gvi"(error in=s5) -> (error out=w88)
  s6 = w5  # shift register
  while {
    w89 = $Station
    Feedback Node(input=w89) -> w90
    Logical Exclusive Or(w89, w90) -> w91
    case (w91) {
      frame False, Default {
        w92 = s6
      }
      frame True {
        case (w89) {
          frame False, Default {
            sequence {
              frame 0 {
                $"Station Active" <- w89
              }
            }
            call "802.11 Unbundle Session.gvi"(session=$session) -> (UDP receiver=w93)
            Udp Close(connection ID=w93, error in=s6) -> (error out=w94)
            call "Clear Errors.gvi"(specific error code to clear=1, error in=w94) -> (error out=w95)
            call "802.11 Abort RF Streams.gvi"(session=$session, error in=w95) -> (error out=w92)
          }
          frame True {
            w96 = 4061  # packet size in byte
            call "802.11 Random Bit Generator.gvi"(packet size=w96) -> (random array=w97)
            call "802.11 FPGA Target Configuration.gvi"() -> (maximum gain=w98, enable DC offset correction=w99)
            w100 = T14 {"remove header"=TRUE, "block unsupported frame types"=TRUE, "block FCS errors"=TRUE, "block address mismatch"=TRUE, "block header recognize error"=TRUE}
            call "802.11 Configure Static Parameters.gvi"(session in=$session, error in=s6, primary subband=$"Primary Subband", operation mode=$"Operation Mode", enable DC offset correction=w99, MPDU filter configuration=w100, device MAC address=$"Device MAC Address") -> (session dup=w101, error out=w102)
            call "802.11 Reset Statistics.gvi"(session in=w101, error in=w102, reset RX statistics=TRUE, reset TX statistics=TRUE) -> (error out=w103, session dup=w104)
            call "802.11 Configure TX RF.gvi"(TX port=$"TX Port (USRP only)", session=w104, TX frequency=$"TX Frequency [Hz]", TX power level=$"Power Level [dBm]", error in=w103) -> (session dup=w105, error out=w106, coerced TX power level=w107, coerced LO frequency=w108)
            call "802.11 Configure RX RF.gvi"(RX frequency=$"TX Frequency [Hz]", session=w105, RX gain=w98, error in=w106, RX port=$"RX Port (USRP only)") -> (error out=w109, session dup=w110, coerced RX gain=w111, coerced LO frequency=w112)
            call "802.11 Configure AGC Registers.gvi"(TX Port=$"TX Port (USRP only)", enable AGC=FALSE, session=w110, RX port=$"RX Port (USRP only)", error in=w109) -> (error out=w113, session dup=w114)
            call "802.11 Set Power Calibration Offset.gvi"(session=w114, frequency=$"TX Frequency [Hz]", error in=w113, RX port=$"RX Port (USRP only)") -> (session dup=w115, error out=w116)
            call "802.11 Configure RF Streams.gvi"(TX port=$"TX Port (USRP only)", RX port=$"RX Port (USRP only)", session=w115, error in=w116) -> (session dup=w117, error out=w118)
            Property Node(instance in=w117) -> ("UDP Receiver"=w119, "UDP Receiver_2"=w120, "UDP Receiver_3"=w121, "UDP Receiver_4"=w122, "UDP Receiver_5"=w123)
            Array Index(array=$"Receive Port") -> (out0[1]=w124)
            call "802.11 Configure Data Source.gvi"(error in=w118, receive port=w124, UDP Receiver 1=w119) -> (error out=w125, UDP Receiver out 1=w126, success?=w127)
            Array Index(array=$"Receive Port") -> (out0[2]=w128)
            call "802.11 Configure Data Source_2.gvi"(receive port=w128, UDP Receiver 2=w120) -> (error out=w129, UDP Receiver out 2=w130, success?=w131)
            Array Index(array=$"Receive Port") -> (out0[3]=w132)
            call "802.11 Configure Data Source_3.gvi"(receive port=w132, UDP Receiver 3=w121) -> (error out=w133, UDP Receiver out 3=w134, success?=w135)
            Array Index(array=$"Receive Port") -> (out0[4]=w136)
            call "802.11 Configure Data Source_4.gvi"(receive port=w136, UDP Receiver 4=w122) -> (error out=w137, UDP Receiver out 4=w138, success?=w139)
            # Yue 09/14/2017
            # 1. create 5 UDP Sources
            # 2. make the receive port as a vector
            Array Index(array=$"Receive Port") -> (out0[5]=w140)
            call "802.11 Configure Data Source_5.gvi"(receive port=w140, UDP Receiver 5=w123) -> (error out=w141, UDP Receiver out 5=w142, success?=w143)
            Property Node(instance in=$session, "PN packet"=w97, "UDP Receiver"=w126, "UDP Receiver_2"=w130, "UDP Receiver_3"=w134, "UDP Receiver_4"=w138, "UDP Receiver_5"=w142) -> (instance out=w144)
            $session <- w144
            $"RX Frequency [Hz]" <- $"TX Frequency [Hz]"
            Merge Errors(w125, w129, w133, w137, w141) -> (error out=w92)
            Logical And(w127, w131, w135, w139, w143) -> w145
            sequence {
              frame 0 {
                $Station <- w145
                $"Station Active" <- w89
              }
            }
            $"Coerced LO frequency RX [Hz]" <- w112
            $"Applied RX Gain [dB]" <- w111
            $"Coerced LO frequency TX [Hz]" <- w108
            $"Coerced Power Level [dBm]" <- w107
          }
        }
      }
    }
    # configuration
    call "802.11 Unbundle Session.gvi"(session=$session) -> (FPGA interface=w146)
    Feedback Node(input=$"Station Active") -> w147
    case ($"Station Active") {
      frame False, Default {
        w148 = s6
      }
      frame True {
        Is Not Equal(x=$"Station Active", y=w147) -> w149
        call "802.11 Gain Control.gvi"(initialize=w149, RX Port (USRP only)=$"RX Port (USRP only)", session=$session, AGC=$AGC, error in=s6, Manual RX gain [dB]=$"Manual RX gain [dB]", RX Frequency [Hz]=$"RX Frequency [Hz]", TX Port (USRP only)=$"TX Port (USRP only)") -> (Applied RX Gain [dB]=w150, error out=w151)
        $"Applied RX Gain [dB]" <- w150
        call "802.11 Subcarrier Format to Configuration.gvi"(MCS=$MCS, subcarrier format=$"Subcarrier Format", error in=s6) -> (error out=w152, format=w153)
        call "802.11 Configure Dynamic Parameters.gvi"(FPGA interface=w146, error in=w152, format=w153, transmit ACK=$"Transmit ACK", backoff value=$Backoff, CCA energy detection threshold=$"CCA Energy Detection Threshold [dBm]") -> (error out=w154)
        Merge Errors(w151, w154) -> (error out=w148)
      }
    }
    call "802.11 Reset Statistics.gvi"(session in=$session, error in=s6, reset RX statistics=$"reset RX staistics", reset TX statistics=$"reset TX staistics") -> (error out=w155)
    call "802.11 Subcarrier Format to Configuration.gvi"(MCS=$MCS, subcarrier format=$"Subcarrier Format", error in=w155) -> (modulation and coding rate=w156, error out=w157)
    Merge Errors(w148, w92, w157) -> (error out=w158)
    call "Create Stop.gvi"(error in=w158, stop in=$Stop) -> (error out=w159)
    call "Check Stop.gvi"(error in=w159) -> (error out=w160, stop=w161)
    Wait Until Next Multiple(multiple to wait=100)
    $"modulation and coding rate" <- w156
    next s6 = w160
    stop if w161
  }
  call "Stop On Error.gvi"(error in=s6) -> (error out=w162)
  Udp Open(error in=w5, net address=0, port=0, service name="", timeout ms=25000) -> (connection ID=w163, error out=w164)
  call "Set Socket Option.gvi"(connection in=w163, level=0xFFFF, option name=0x1001, value=1024000, error in=w164) -> (error out=w165, connection out=w166)
  s7 = w165  # shift register
  s8 = w166  # shift register
  while {
    Wait Until Next Multiple(multiple to wait=0)
    # UDP send and receive
    call "802.11 Unbundle Session.gvi"(session=$session) -> (send queue=w167, receive queue=w168, PN packet=w169)
    case ($"Station Active") {
      frame False, Default {
        w170 = s7
        w171 = s8
      }
      frame True {
        Array Subset(array=w169, length0=$"PN Data Packet Size") -> w172
        case ($"Data Source") {
          frame "UDP" {
            # UDP
            Property Node(instance in=$session) -> ("UDP Receiver_5"=w175, "UDP Receiver_4"=w176, "UDP Receiver_4"=w177, "UDP Receiver_2"=w178, "UDP Receiver"=w179)
            Property Node(instance in=$session) -> ("send queue_5"=w180, "send queue_4"=w181, "send queue_3"=w182, "send queue_2"=w183, "send queue"=w184)
            call "802.11 Receive UDP Data.gvi"(UDP receiver=w179, send queue=w184, error in=s7) -> (data transfer=w185, error out=w186, FIFO full=w187)
            call "802.11 Receive UDP Data_2.gvi"(UDP receiver=w178, send queue=w183, error in=s7) -> (data transfer=w188, error out=w189, FIFO full=w190)
            call "802.11 Receive UDP Data_3.gvi"(UDP receiver=w177, send queue=w182, error in=s7) -> (data transfer=w191, error out=w192, FIFO full=w193)
            call "802.11 Receive UDP Data_4.gvi"(UDP receiver=w176, send queue=w181, error in=s7) -> (data transfer=w194, error out=w195, FIFO full=w196)
            call "802.11 Receive UDP Data_5.gvi"(UDP receiver=w175, send queue=w180, error in=s7) -> (data transfer=w197, error out=w198, FIFO full=w199)
            # Yue 09/14/2017
            # 1. put 5 queues into recerive UDP DATA block
            Logical And(w185, w188, w191, w194, w197) -> w174
            Merge Errors(w198, w195, w192, w189, w186) -> (error out=w173)
            Logical And(w199, w196, w193, w190, w187) -> w200
            $"FIFO Full" <- w200
          }
          frame "PN Data" {
            # PN data
            call "802.11 Send PN Data.gvi"(PN packets per second=$"PN Packets per Second", send queue=w167, PN data=w172, error in=s7) -> (data transfer=w174, error out=w173)
          }
          frame "Manual", Default {
            # Manual
            case ($"Trigger TX") {
              frame False, Default {
                w173 = s7
                w174 = $"Trigger TX"
              }
              frame True {
                Enqueue Element(element=w172, error in=s7, queue=w167, timeout in ms=-1) -> (error out=w173, queue out=w201)
                w174 = $"Trigger TX"
              }
            }
          }
        }
        $"Data Transfer" <- w174
        Is Equal(x=$"Data Sink", y="UDP") -> w202
        call "802.11 Send UDP Data.gvi"(target port=$"Transmit Port", target IP address=$"Transmit IP Address", receive queue=w168, UDP sender=s8, enable=w202, error in=s7) -> (FIFO full=w203, error out=w204, UDP sender dup=w171, data transfer=w205)
        $"Data Transfer" <- w205
        $"FIFO Full" <- w203
        Merge Errors(w173, w204) -> (error out=w170)
      }
    }
    call "Check Stop.gvi"(error in=w170) -> (error out=w206, stop=w207)
    next s7 = w206
    next s8 = w171
    stop if w207
  }
  call "Stop On Error.gvi"(error in=s7) -> (error out=w208)
  Udp Close(connection ID=s8, error in=w208) -> (error out=w209)
  Merge Errors(w162, w88, w12, w209, w56, w67) -> (error out=w210)
  sequence {
    frame 0 {
      w211 = $session
    }
  }
  call "802.11 Host Release.gvi"(session=w211, error in=w210) -> (error out=w212)
  call "Simple Error Handler.gvi"(type of dialog="OK message", error in=w212)
